# Grasshopper definition 180813_LivingLine Data Viz.gh (Grasshopper 0.9.76)
# plug-ins: Python Interpreter

# AP Connections
panel = Panel("C:\Users\RYAN\Google Drive\MAS\Tongji D&I\LivingLine Data\Wi-Fi Data\Data Sample\180731_reformat for viz_Weiting\")  # disabled
panel_2 = Panel("rawdata_2018_06_19.csv")  # disabled
panel_3 = Panel("cleandata_2018_06_19.csv")  # disabled
# User Trace (Detailed)
panel_4 = Panel("C:\Users\RYAN\Google Drive\MAS\Tongji D&I\LivingLine Data\Wi-Fi Data\Data Sample\180812_csv for viz_Weiting\")  # disabled
panel_5 = Panel("max24094_freq_0728vis.csv")  # disabled
swatch = ColourSwatch(SwatchColor=RGB(128, 159, 255))
panel_6 = Panel("16_freq_0728vis.csv")  # disabled
panel_7 = Panel("840_freq_0728vis.csv")  # disabled
panel_8 = Panel("4942_freq_0728vis.csv")  # disabled
# Id: individual id number;
# 
# X: x coordinate for individual (I use WGS84 coordination system and the unit is milimeter)
# 
# Y: y coordinate for individual
# 
# Timestamps: actual time
# 
# Ts: unix time
# 
# Probe: the apmac that each individual connects with
# 
# Apmac_number: the number of the apmac shown on CAD and also on the TD website
# 
# r_coordinatex:  x coordinate for each apmac (I use WGS84 coordination system and the unit is milimeter)
# 
# r_coordinatey: : y coordinate for each apmac
panel_9 = Panel("10915_freq_0728vis.csv")  # disabled

# ---- group: Text Pt
pt = Point(<point referenced from the Rhino model>)  # disabled

# ----
# User Trace
panel_10 = Panel("C:\Users\RYAN\Google Drive\MAS\Tongji D&I\LivingLine Data\Wi-Fi Data\Data Sample\180812_csv for viz_Weiting\")
swatch_2 = ColourSwatch(SwatchColor=RGB(140, 0, 255))
panel_11 = Panel("16_freq_0728vis.csv")
panel_12 = Panel("840_freq_0728vis.csv")
panel_13 = Panel("4942_freq_0728vis.csv")

# ---- group: time step
number_slider = Slider(177, range=0..287)  # disabled

# ----
panel_14 = Panel("10915_freq_0728vis.csv")

# ---- group: Outdoor AP Range Crvs
# MIT Media Lab | City Science
# 'Ryan' Yan Zhang <ryanz@mit.edu>
# Weiting Xiong, Ronan Doorley, 'Suta' Ke Ma, Shuyang Du, Kent Larson
# 2018.July
# AP Points
crv = Curve([<curve referenced from the Rhino model> x2])

# ---- group: Text Pt
pt_2 = Point(<point referenced from the Rhino model>)  # disabled

pt_3 = Point(<point referenced from the Rhino model>)

# ---- group: anim current time
# Stay Point
number_slider_2 = Slider(499, range=0..499)

# ---- group: Indoor AP Range Crvs
crv_2 = Curve([<curve referenced from the Rhino model> x25])

# ----
lng = ListLength(List=crv_2)

# ---- group: anim current time
number_slider_3 = Slider(138, range=0..138)  # disabled

# ----
area = Area(Geometry=crv)  # -> Area, Centroid
area_2 = Area(Geometry=crv_2)  # -> Area, Centroid
series = Series(Start="1", Step="1", Count=lng)
lng_2 = ListLength(List=crv)
int = Integer(series)

# ---- group: Indoor AP Center Pts
pt_4 = Point(area_2.Centroid)

# ----
swatch_3 = ColourSwatch(SwatchColor=RGB(255, 128, 0))  # disabled
panel_15 = Panel("2500")  # disabled
series_2 = Series(Start=1, Step=1, Count=lng_2)
repeat = RepeatData(Data="OUT-", Length=lng_2)

# ---- group: Outdoor AP Center Pts
pt_5 = Point(area.Centroid)

# ----
swatch_4 = ColourSwatch(SwatchColor=RGB(255, 128, 0))  # disabled
panel_16 = Panel("2500")  # disabled

# ---- group: Indoor AP ID list
txt = Text(int)

# ----
int_2 = Integer(series_2)
cir = Circle(Plane=pt_4, Radius="800")
cir_2 = Circle(Plane=pt_5, Radius="1200")
merge = Merge(Data1=graft(repeat), Data2=graft(int_2))

# ---- group: file name
txt_2 = Text("max24094_freq_0728vis.csv")

# ----
panel_17 = Panel(txt_2)

# ---- group: File Name Label
tag = TextTag3D(Location=pt_3, Text=panel_17, Size="2500", Colour=ColourSwatch(SwatchColor=RGB(255, 128, 0)), Justification=1)

# ---- group: file name
txt_3 = Text(panel_2)  # disabled

# ----
panel_18 = Panel(txt_3)  # disabled

# ---- group: File Name Label
tag_2 = TextTag3D(Location=pt, Text=panel_18, Size=panel_15, Colour=swatch_3, Justification=1)  # disabled

# ---- group: file name
txt_4 = Text(panel_6)  # disabled

# ----
panel_19 = Panel(txt_4)  # disabled

# ---- group: File Name Label
tag_3 = TextTag3D(Location=pt_2, Text=panel_19, Size=panel_16, Colour=swatch_4, Justification=1)  # disabled

# ---- group: Indoor AP Center Dot Crvs
crv_3 = Curve(cir)

# ---- group: Outdoor AP Center Dot Crvs
crv_4 = Curve(cir_2)

# ----
join = TextJoin(Text=merge)
merge_2 = Merge(Data1=panel, Data2=txt_3)  # disabled
merge_3 = Merge(Data1=panel_4, Data2=txt_4)  # disabled
merge_4 = Merge(Data1=panel_10, Data2=txt_2)
multiplication = Multiplication(A="1200", B=-1.5)
pshift = ShiftPaths(Data=join, Offset=-1)
multiplication_2 = Multiplication(A="800", B=-1.5)
panel_20 = Panel(",")  # disabled
boundary = BoundarySurfaces(Edges=crv_3)
boundary_2 = BoundarySurfaces(Edges=crv_4)
join_2 = TextJoin(Text=merge_2)  # disabled
path = FilePath(join_2)  # disabled
join_3 = TextJoin(Text=merge_3)  # disabled
join_4 = TextJoin(Text=merge_4)
Y = UnitY(Factor=multiplication)
path_2 = FilePath(join_3)  # disabled
Y_2 = UnitY(Factor=multiplication_2)
path_3 = FilePath(join_4)
mcol = MeshColours(Mesh=boundary, Colours=swatch)
mcol_2 = MeshColours(Mesh=boundary_2, Colours=swatch_2)
move = Move(Geometry=pt_5, Motion=Y)  # -> Geometry, Transform
panel_21 = Panel(",")  # disabled
file = ReadFile(File=path, PerLineParse=True)  # disabled

# ---- group: column name row
item = ListItem(List=file, Index=0, Wrap=True)  # disabled

# ----
split = TextSplit(Text=item, Separators=panel_20)  # disabled
move_2 = Move(Geometry=pt_4, Motion=Y_2)  # -> Geometry, Transform
panel_22 = Panel(",")  # disabled
panel_23 = Panel(",")  # disabled
lng_3 = ListLength(List=file)  # disabled
file_2 = ReadFile(File=path_2, PerLineParse=True)  # disabled
lng_4 = ListLength(List=file_2)  # disabled
panel_24 = Panel(lng_4)  # disabled

# ---- group: column name row
item_2 = ListItem(List=file_2, Index=0, Wrap=True)  # disabled

# ---- group: all data row
shift = ShiftList(List=file_2, Shift=1, Wrap=False)  # disabled

# ----
file_3 = ReadFile(File=path_3, PerLineParse=True)
lng_5 = ListLength(List=file_3)
panel_25 = Panel(lng_5)

# ---- group: column name row
item_3 = ListItem(List=file_3, Index=0, Wrap=True)

# ---- group: all data row
shift_2 = ShiftList(List=file_3, Shift=1, Wrap=False)

# ----
panel_26 = Panel(split)  # disabled

# ---- group: Outdoor AP Center Dot
mesh = Mesh(mcol_2)

# ---- group: Outdoor AP ID Labels
tag_4 = TextTag3D(Location=move.Geometry, Text=pshift, Size="1200", Colour=swatch_2, Justification=2)

# ---- group: Indoor AP Center Dot
mesh_2 = Mesh(mcol)

# ---- group: Indoor AP ID Labels
tag_5 = TextTag3D(Location=move_2.Geometry, Text=txt, Size="1200", Colour=swatch, Justification=2)

# ----
split_2 = TextSplit(Text=item_2, Separators=panel_23)  # disabled
split_3 = TextSplit(Text=shift, Separators=panel_22)  # disabled
split_4 = TextSplit(Text=item_3, Separators=",")
split_5 = TextSplit(Text=shift_2, Separators=",")
subtraction = Subtraction(A=lng_3, B=1)  # disabled
panel_27 = Panel("288")  # disabled
split_6 = TextSplit(Text=file, Separators=panel_21)  # disabled
pshift_2 = ShiftPaths(Data=split_3, Offset=2)  # disabled
pshift_3 = ShiftPaths(Data=split_5, Offset=2)
panel_28 = Panel(split_2)  # disabled
panel_29 = Panel(split_4)
division = Division(A=subtraction, B=panel_27)  # disabled
pshift_4 = ShiftPaths(Data=split_6, Offset=1)  # disabled

# ---- group: total id number
int_3 = Integer(division)  # disabled

# ----
item_4 = ListItem(List=pshift_4, Index=2, Wrap=False)  # disabled
item_5 = ListItem(List=pshift_4, Index=1, Wrap=False)  # disabled
item_6 = ListItem(List=pshift_4, Index=3, Wrap=False)  # disabled
item_7 = ListItem(List=pshift_4, Index=4, Wrap=False)  # disabled
panel_30 = Panel("4")  # disabled
panel_31 = Panel("6")  # disabled
panel_32 = Panel("0")  # disabled
pshift_5 = ShiftPaths(Data=item_4, Offset=-1)  # disabled
pshift_6 = ShiftPaths(Data=item_5, Offset=-1)  # disabled
pshift_7 = ShiftPaths(Data=item_6, Offset=-1)  # disabled
pshift_8 = ShiftPaths(Data=item_7, Offset=-1)  # disabled
series_3 = Series(Start=number_slider, Step=panel_27, Count=int_3)  # disabled
item_8 = ListItem(List=pshift_2, Index=panel_30, Wrap=False)  # disabled
item_9 = ListItem(List=pshift_2, Index=panel_32, Wrap=False)  # disabled
item_10 = ListItem(List=pshift_2, Index=panel_31, Wrap=False)  # disabled
item_11 = ListItem(List=pshift_3, Index="2", Wrap=False)
item_12 = ListItem(List=pshift_3, Index="0", Wrap=False)
item_13 = ListItem(List=pshift_3, Index="6", Wrap=False)
shift_3 = ShiftList(List=pshift_5, Shift=1, Wrap=False)  # disabled
shift_4 = ShiftList(List=pshift_7, Shift=1, Wrap=False)  # disabled
shift_5 = ShiftList(List=pshift_8, Shift=1, Wrap=False)  # disabled
shift_6 = ShiftList(List=pshift_6, Shift=1, Wrap=False)  # disabled
pshift_9 = ShiftPaths(Data=item_8, Offset=-1)  # disabled
pshift_10 = ShiftPaths(Data=item_10, Offset=-1)  # disabled
pshift_11 = ShiftPaths(Data=item_11, Offset=-1)
pshift_12 = ShiftPaths(Data=item_9, Offset=-1)  # disabled
pshift_13 = ShiftPaths(Data=item_13, Offset=-1)
pshift_14 = ShiftPaths(Data=item_12, Offset=-1)

# ---- group: time
txt_5 = Text(shift_3)  # disabled

# ---- group: selected time
int_4 = Integer(series_3)  # disabled

# ---- group: all # connections
int_5 = Integer(shift_5)  # disabled

# ---- group: all IDs
int_6 = Integer(shift_6)  # disabled

# ---- group: 5 min time id
int_7 = Integer(shift_4)  # disabled

# ---- group: data intergraty viewer
pt_6 = ConstructPoint(XCoordinate=int_6, YCoordinate=int_7, ZCoordinate=0)

# ---- group: trim to second
fragment = TextFragment(Text=pshift_9, Start=0, Count=10)  # disabled

fragment_2 = TextFragment(Text=pshift_11, Start=0, Count=10)

# ----
item_14 = ListItem(List=txt_5, Index=int_4, Wrap=False)  # disabled
item_15 = ListItem(List=int_5, Index=int_4, Wrap=False)  # disabled
item_16 = ListItem(List=int_6, Index=int_4, Wrap=False)  # disabled
item_17 = ListItem(List=int_7, Index=int_4, Wrap=False)  # disabled

# ---- group: send time epoch
int_8 = Integer(fragment)  # disabled

# ---- group: ap ids
int_9 = Integer(pshift_10)  # disabled

# ---- group: device macs
txt_6 = Text(pshift_12)  # disabled

# ---- group: send time epoch
int_10 = Integer(fragment_2)

# ---- group: ap ids
int_11 = Integer(pshift_13)

# ---- group: device macs
txt_7 = Text(pshift_14)

# ----
panel_33 = Panel(int_8)  # disabled
panel_34 = Panel(int_9)  # disabled
panel_35 = Panel(txt_6)  # disabled
panel_36 = Panel(int_10)
panel_37 = Panel(int_11)
panel_38 = Panel(txt_7)
panel_39 = Panel(item_14)  # disabled

# ---- group: selected IDs
int_12 = Integer(item_16)  # disabled

# ---- group: selected # connections
int_13 = Integer(item_15)  # disabled

# ----
number_slider_4 = Slider(6.41, range=1..30)  # disabled
sort = SortList(Keys=int_8)  # -> Keys, ValuesA; disabled
sort_2 = SortList(Keys=int_8, ValuesA=txt_6)  # -> Keys, ValuesA; disabled
sort_3 = SortList(Keys=int_8, ValuesA=int_9)  # -> Keys, ValuesA; disabled
sort_4 = SortList(Keys=int_10)  # -> Keys, ValuesA
sort_5 = SortList(Keys=int_10, ValuesA=txt_7)  # -> Keys, ValuesA
sort_6 = SortList(Keys=int_10, ValuesA=int_11)  # -> Keys, ValuesA
item_18 = ListItem(List=pt_4, Index=int_12, Wrap=False)  # disabled
multiplication_3 = Multiplication(A=int_13, B=number_slider_4)  # disabled
panel_40 = Panel("0")  # disabled
panel_41 = Panel("2000")  # disabled

# ---- group: send time epoch sorted
int_14 = Integer(sort.Keys)  # disabled

# ---- group: ap ids sorted
int_15 = Integer(sort_3.ValuesA)  # disabled

# ---- group: device macs sorted
txt_8 = Text(sort_2.ValuesA)  # disabled

# ---- group: send time epoch sorted
int_16 = Integer(sort_4.Keys)

# ---- group: ap ids sorted
int_17 = Integer(sort_6.ValuesA)

# ---- group: device macs sorted
txt_9 = Text(sort_5.ValuesA)

# ----
item_19 = ListItem(List=item_14, Index=0, Wrap=False)  # disabled

# ---- group: selected center pts
pt_7 = Point(item_18)  # disabled

# ----
dom = ConstructDomain(DomainStart=panel_40, DomainEnd=panel_41)  # disabled
subset = SubList(List=int_15, Domain=dom, Wrap=False)  # -> List, Index; disabled
subset_2 = SubList(List=txt_8, Domain=dom, Wrap=False)  # -> List, Index; disabled
subset_3 = SubList(List=int_14, Domain=dom, Wrap=False)  # -> List, Index; disabled
dom_2 = ConstructDomain(DomainStart="0", DomainEnd="499")
subset_4 = SubList(List=int_17, Domain=dom_2, Wrap=False)  # -> List, Index
subset_5 = SubList(List=txt_9, Domain=dom_2, Wrap=False)  # -> List, Index
subset_6 = SubList(List=int_16, Domain=dom_2, Wrap=False)  # -> List, Index

# ---- group: time
txt_10 = Text(item_19)  # disabled

# ----
cir_3 = Circle(Plane=pt_7, Radius=multiplication_3)  # disabled

# ---- group: ap ids sorted selected
int_18 = Integer(subset.List)  # disabled

# ---- group: send time epoch sorted selected
int_19 = Integer(subset_3.List)  # disabled

# ---- group: device macs sorted selected
txt_11 = Text(subset_2.List)  # disabled

# ---- group: ap ids sorted selected
int_20 = Integer(subset_4.List)

# ---- group: send time epoch sorted selected
int_21 = Integer(subset_6.List)

# ---- group: device macs sorted selected
txt_12 = Text(subset_5.List)

# ----
swatch_5 = ColourSwatch(SwatchColor=RGBA(68, 84, 135, 100))  # disabled
boundary_3 = BoundarySurfaces(Edges=cir_3)  # disabled
panel_42 = Panel(subset_3.List)  # disabled
panel_43 = Panel(subset.List)  # disabled
panel_44 = Panel(txt_11)  # disabled
panel_45 = Panel(int_21)
panel_46 = Panel(int_20)
panel_47 = Panel(txt_12)

# ---- group: epoch time
int_22 = Integer()

# ---- group: Text Pt
pt_8 = Point(<point referenced from the Rhino model>)  # disabled

# ----
preview = CustomPreview(Geometry=boundary_3, Shader=swatch_5)  # disabled
epoch2human_py = PythonScript(e=int_22)  # -> out, h
# ---------- epoch2human_py: Python ----------
import time
print e
h = time.strftime('%Y-%m-%d %H:%M:%S', time.localtime(e))
# ---------- end epoch2human_py ----------
panel_48 = Panel(txt_10)  # disabled
panel_49 = Panel("1")  # disabled
epoch2human_py_2 = PythonScript(e=subset_3.List)  # -> out, h; disabled; same code as epoch2human_py
epoch2human_py_3 = PythonScript(e=int_21)  # -> out, h; same code as epoch2human_py

# ---- group: ap id to list id
subtraction_2 = Subtraction(A=int_18, B=panel_49)  # disabled

# ----
item_20 = ListItem(List=int_21, Index=number_slider_2, Wrap=False)

# ---- group: ap id to list id
subtraction_3 = Subtraction(A=int_20, B="1")

# ----
panel_50 = Panel(epoch2human_py_2.h)  # disabled
panel_51 = Panel(epoch2human_py_3.h)
item_21 = ListItem(List=int_19, Index=0, Wrap=False)  # disabled
item_22 = ListItem(List=pt_4, Index=subtraction_2, Wrap=False)  # disabled
item_23 = ListItem(List=pt_4, Index=subtraction_3, Wrap=False)

# ---- group: epoch time
int_23 = Integer(item_20)

# ----
addition = Addition(A=item_21, B=number_slider_3)  # disabled

# ---- group: ap location pts
pt_9 = Point(item_22)  # disabled

pt_10 = Point(item_23)

# ----
swatch_6 = ColourSwatch(SwatchColor=RGB(255, 128, 0))  # disabled
panel_52 = Panel("2500")  # disabled
pline = PolyLine(Vertices=pt_9, Closed=False)  # disabled
epoch2human_py_4 = PythonScript(e=int_23)  # -> out, h; same code as epoch2human_py
pline_2 = PolyLine(Vertices=pt_10, Closed=False)
panel_53 = Panel("800")  # disabled
epoch2human_py_5 = PythonScript(e=addition)  # -> out, h; disabled; same code as epoch2human_py
shift_7 = ShiftList(List=pt_9, Shift=1, Wrap=False)  # disabled
shift_8 = ShiftList(List=pt_9, Shift=-1, Wrap=False)  # disabled

# ---- group: trace crv
crv_5 = Curve(pline)  # disabled

crv_6 = Curve(pline_2)

# ----
panel_54 = Panel(epoch2human_py_4.h)

# ---- group: time
txt_13 = Text(panel_54)

# ---- group: Time Label
tag_6 = TextTag3D(Location=pt_8, Text=panel_48, Size=panel_52, Colour=swatch_6, Justification=3)  # disabled

# ----
panel_55 = Panel(epoch2human_py_5.h)  # disabled

# ---- group: time
txt_14 = Text(panel_55)  # disabled

# ----
shift_9 = ShiftList(List=int_19, Shift=1, Wrap=False)  # disabled
shift_10 = ShiftList(List=int_19, Shift=-1, Wrap=False)  # disabled
shift_11 = ShiftList(List=int_21, Shift=1, Wrap=False)
shift_12 = ShiftList(List=int_21, Shift=-1, Wrap=False)
ln = Line(StartPoint=shift_8, EndPoint=shift_7)  # disabled
subtraction_4 = Subtraction(A=shift_9, B=shift_10)  # disabled

# ---- group: epoch time
int_24 = Integer()  # disabled

# ---- group: Text Pt
pt_11 = Point(<point referenced from the Rhino model>)

# ----
subtraction_5 = Subtraction(A=shift_11, B=shift_12)
swatch_7 = ColourSwatch(SwatchColor=RGB(255, 128, 0))

# ---- group: epoch time
int_25 = Integer()

# ---- group: Text Pt
pt_12 = Point(<point referenced from the Rhino model>)  # disabled

# ----
swatch_8 = ColourSwatch(SwatchColor=RGB(255, 128, 0))  # disabled
epoch2human_py_6 = PythonScript(e=int_24)  # -> out, h; disabled; same code as epoch2human_py
panel_56 = Panel(" ")  # disabled
panel_57 = Panel("")  # disabled

# ---- group: seconds passed
int_26 = Integer(subtraction_4)  # disabled

# ----
divide = DivideCurve(Curve=ln, Count=int_26, Kinks=False)  # -> Points, Tangents, Parameters; disabled

# ---- group: seconds passed
int_27 = Integer(subtraction_5)

# ----
epoch2human_py_7 = PythonScript(e=int_25)  # -> out, h; same code as epoch2human_py
# RSSI graph (temp)
path_4 = FilePath("C:\Users\RYAN\Google Drive\MAS\Tongji D&I\LivingLine Data\Wi-Fi Data\AP Info\RSSI to Meter_plot.txt")  # disabled
rep = ReplaceText(Text=panel_54, Find=" ", RecursiveReplace=False)
shift_13 = ShiftList(List=divide.Points, Shift=-1, Wrap=False)  # disabled
rep_2 = ReplaceText(Text=panel_55, Find=panel_56, Replace=panel_57, RecursiveReplace=False)  # disabled
panel_58 = Panel(txt_13)
panel_59 = Panel(",")  # disabled
panel_60 = Panel(txt_14)  # disabled
panel_61 = Panel(rep)
file_4 = ReadFile(File=path_4, PerLineParse=True)  # disabled
pshift_15 = ShiftPaths(Data=shift_13, Offset=-3)  # disabled
panel_62 = Panel(rep_2)  # disabled
panel_63 = Panel("1600")  # disabled
multiplication_4 = Multiplication(A="1600", B=3)

# ---- group: all trace pts
pt_13 = Point(pshift_15)  # disabled

# ----
item_24 = ListItem(List=pt_13, Index=number_slider_3, Wrap=False)  # disabled

# ---- group: anim current trace pt
pt_14 = Point(item_24)  # disabled

# ----
cir_4 = Circle(Plane=pt_14, Radius=panel_53)  # disabled
boundary_4 = BoundarySurfaces(Edges=cir_4)  # disabled
mcol_3 = MeshColours(Mesh=boundary_4, Colours=swatch_8)  # disabled

# ---- group: all trace pts
pt_15 = Point(pt_10)

# ----
item_25 = ListItem(List=pt_15, Index=number_slider_2, Wrap=False)

# ---- group: anim current trace pt
pt_16 = Point(item_25)

# ----
cir_5 = Circle(Plane=pt_16, Radius="800")
boundary_5 = BoundarySurfaces(Edges=cir_5)
mcol_4 = MeshColours(Mesh=boundary_5, Colours=swatch_7)
split_7 = TextSplit(Text=file_4, Separators=panel_59)  # disabled
multiplication_5 = Multiplication(A=panel_63, B=3)  # disabled
panel_64 = Panel("200")  # disabled
Y_3 = UnitY(Factor=multiplication_4)
cir_6 = Circle(Plane=pt_13, Radius=panel_64)  # disabled
cir_7 = Circle(Plane=pt_15, Radius="200")
Y_4 = UnitY(Factor=multiplication_5)  # disabled
move_3 = Move(Geometry=pt_16, Motion=Y_3)  # -> Geometry, Transform
swatch_9 = ColourSwatch(SwatchColor=RGBA(128, 157, 255, 100))  # disabled
swatch_10 = ColourSwatch(SwatchColor=RGBA(173, 87, 0, 128))  # disabled
swatch_11 = ColourSwatch(SwatchColor=RGBA(87, 111, 186, 100))  # disabled
swatch_12 = ColourSwatch(SwatchColor=RGBA(181, 91, 0, 128))  # disabled
swatch_13 = ColourSwatch(SwatchColor=RGBA(128, 157, 255, 100))
move_4 = Move(Geometry=pt_14, Motion=Y_4)  # -> Geometry, Transform; disabled
swatch_14 = ColourSwatch(SwatchColor=RGBA(87, 111, 186, 100))
boundary_6 = BoundarySurfaces(Edges=cir_6)  # disabled
swatch_15 = ColourSwatch(SwatchColor=RGB(255, 128, 0))  # disabled
panel_65 = Panel("2500")  # disabled
boundary_7 = BoundarySurfaces(Edges=cir_7)
pshift_16 = ShiftPaths(Data=split_7, Offset=1)  # disabled

# ---- group: Time Label
tag_7 = TextTag3D(Location=move_3.Geometry, Text=panel_61, Size="1600", Colour=swatch_7, Justification=8)

# ---- group: anim current trace pt
mesh_3 = Mesh(mcol_4)

# ---- group: Time Label
tag_8 = TextTag3D(Location=pt_11, Text=panel_58, Size="2500", Colour=ColourSwatch(SwatchColor=RGB(255, 128, 0)), Justification=3)

# ---- group: trace crv
preview_2 = CustomPreview(Geometry=crv_5, Shader=swatch_12)  # disabled

# ---- group: Time Label
tag_9 = TextTag3D(Location=move_4.Geometry, Text=panel_62, Size=panel_63, Colour=swatch_8, Justification=8)  # disabled

# ---- group: all trace pts
preview_3 = CustomPreview(Geometry=boundary_6, Shader=swatch_10)  # disabled

# ---- group: anim current trace pt
mesh_4 = Mesh(mcol_3)  # disabled

# ---- group: trace crv
preview_4 = CustomPreview(Geometry=crv_6, Shader=ColourSwatch(SwatchColor=RGBA(181, 91, 0, 128)))

# ---- group: all trace pts
preview_5 = CustomPreview(Geometry=boundary_7, Shader=ColourSwatch(SwatchColor=RGBA(173, 87, 0, 128)))

# ---- group: Time Label
tag_10 = TextTag3D(Location=pt_12, Text=panel_60, Size=panel_65, Colour=swatch_15, Justification=3)  # disabled

# ----
item_26 = ListItem(List=pshift_16, Index=0, Wrap=False)  # disabled
item_27 = ListItem(List=pshift_16, Index=1, Wrap=False)  # disabled
number_slider_5 = Slider(3.81, range=0..10)  # disabled
pshift_17 = ShiftPaths(Data=item_26, Offset=-1)  # disabled
panel_66 = Panel(pshift_17)  # disabled
pshift_18 = ShiftPaths(Data=item_27, Offset=-1)  # disabled
panel_67 = Panel("log10(x)+y")  # disabled
panel_68 = Panel("ln(x)+y")  # disabled
eval = Evaluate(F=panel_68, x=pshift_18, y=number_slider_5)  # disabled
pt_17 = ConstructPoint(XCoordinate=pshift_17, YCoordinate=eval, ZCoordinate=0)  # disabled
