# Grasshopper definition 180731_LivingLine Data Viz_AP Connection.gh (Grasshopper 0.9.76)

panel = Panel("C:\Users\RYAN\Google Drive\MAS\Tongji D&I\LivingLine Data\Wi-Fi Data\Data Sample\180731_reformat for viz_Weiting\")
panel_2 = Panel("rawdata_2018_06_19.csv")
merge = Merge(Data1=panel, Data2="cleandata_2018_06_19.csv")

# ---- group: Outdoor AP Range Crvs
crv = Curve([<curve referenced from the Rhino model> x2])

# ---- group: Indoor AP Range Crvs
crv_2 = Curve([<curve referenced from the Rhino model> x24])

# ----
join = TextJoin(Text=merge)
lng = ListLength(List=crv_2)
path = FilePath(join)
area = Area(Geometry=crv)  # -> Area, Centroid
file = ReadFile(File=path, PerLineParse=True)
path_2 = FilePath("C:\Users\RYAN\Google Drive\MAS\Tongji D&I\LivingLine Data\Wi-Fi Data\RSSI to Meter_plot.txt")
area_2 = Area(Geometry=crv_2)  # -> Area, Centroid

# ---- group: time step
number_slider = Slider(287, range=0..287)

# ----
series = Series(Start="1", Step="1", Count=lng)
lng_2 = ListLength(List=file)
file_2 = ReadFile(File=path_2, PerLineParse=True)
int = Integer(series)

# ---- group: Indoor AP Center Pts
pt = Point(area_2.Centroid)

# ----
split = TextSplit(Text=file, Separators=",")
subtraction = Subtraction(A=lng_2, B=1)

# ---- group: Outdoor AP Center Pts
pt_2 = Point(area.Centroid)

# ---- group: Indoor AP ID list
txt = Text(int)

# ----
cir = Circle(Plane=pt, Radius="800")
cir_2 = Circle(Plane=pt_2, Radius="1600")
split_2 = TextSplit(Text=file_2, Separators=",")
pshift = ShiftPaths(Data=split, Offset=1)
item = ListItem(List=pshift, Index=1, Wrap=False)
item_2 = ListItem(List=pshift, Index=4, Wrap=False)

# ---- group: Indoor AP Center Dot Crvs
crv_3 = Curve(cir)

# ---- group: Outdoor AP Center Dot Crvs
crv_4 = Curve(cir_2)

# ----
pshift_2 = ShiftPaths(Data=item, Offset=-1)
pshift_3 = ShiftPaths(Data=item_2, Offset=-1)
boundary = BoundarySurfaces(Edges=crv_3)
boundary_2 = BoundarySurfaces(Edges=crv_4)
division = Division(A=subtraction, B="288")

# ---- group: total id number
int_2 = Integer(division)

# ----
pshift_4 = ShiftPaths(Data=split_2, Offset=1)
shift = ShiftList(List=pshift_3, Shift=1, Wrap=False)
mcol = MeshColours(Mesh=boundary, Colours=ColourSwatch(SwatchColor=RGB(128, 159, 255)))
shift_2 = ShiftList(List=pshift_2, Shift=1, Wrap=False)
mcol_2 = MeshColours(Mesh=boundary_2, Colours=ColourSwatch(SwatchColor=RGB(255, 119, 0)))
item_3 = ListItem(List=pshift_4, Index=0, Wrap=False)
item_4 = ListItem(List=pshift_4, Index=1, Wrap=False)
series_2 = Series(Start=number_slider, Step="288", Count=int_2)
pshift_5 = ShiftPaths(Data=item_3, Offset=-1)
panel_3 = Panel(pshift_5)
pshift_6 = ShiftPaths(Data=item_4, Offset=-1)

# ---- group: selected time
int_3 = Integer(series_2)

# ---- group: all # connections
int_4 = Integer(shift)

# ---- group: all IDs
int_5 = Integer(shift_2)

# ---- group: Outdoor AP Center Dot
mesh = Mesh(mcol_2)

# ---- group: Indoor AP Center Dot
mesh_2 = Mesh(mcol)

# ----
item_5 = ListItem(List=int_4, Index=int_3, Wrap=False)
item_6 = ListItem(List=int_5, Index=int_3, Wrap=False)
eval = Evaluate(F="ln(x)+y", x=pshift_6, y=Slider(3.81, range=0..10))
pt_3 = ConstructPoint(XCoordinate=pshift_5, YCoordinate=eval, ZCoordinate=0)

# ---- group: selected IDs
int_6 = Integer(item_6)

# ----
panel_4 = Panel(int_6)

# ---- group: selected # connections
int_7 = Integer(item_5)

# ----
item_7 = ListItem(List=pt, Index=int_6, Wrap=False)
multiplication = Multiplication(A=int_7, B=Slider(6.41, range=1..30))

# ---- group: selected center pts
pt_4 = Point(item_7)

# ----
cir_3 = Circle(Plane=pt_4, Radius=multiplication)
boundary_3 = BoundarySurfaces(Edges=cir_3)
preview = CustomPreview(Geometry=boundary_3, Shader=ColourSwatch(SwatchColor=RGBA(68, 84, 135, 100)))
